# Grasshopper definition ArchVolumeHops.gh (Grasshopper 1.0.8)

number_slider = Slider(0.79, range=0..1)
length_1 = GetNumber(Slider(49, range=0..100), AtLeast=1, AtMost=1, Maximum=1.797693135e+308, Minimum=-1.797693135e+308, TreeAccess=False)
length_2 = GetNumber(number_slider, AtLeast=1, AtMost=1, Maximum=1.797693135e+308, Minimum=-1.797693135e+308, TreeAccess=False)
count = GetInteger(Slider(7, range=0..50), AtLeast=1, AtMost=1, Maximum=2147483647, Minimum=-2147483648, TreeAccess=False)
Y = UnitY(Factor=1)
pt = ConstructPoint(XCoordinate=0, YCoordinate=0, ZCoordinate=0)
number_slider_2 = Slider(26.49, range=0..100)
line = LineSDL(Start=pt, Direction=Y, Length=length_1)
pi = Pi(Factor="2")
divide = DivideCurve(Curve=line, Count="2", Kinks=False)  # -> simplify(graft(Points)), Tangents, Parameters
range = Range(Domain=pi, Steps=count)
cull_i = CullIndex(List=reverse(range), Indices="0", Wrap=True)  # -> reverse(List)
bang = ExplodeTree(Data=divide.Points)  # -> Branch0, Branch1, Branch2
scale = Scale(Geometry=divide.Points, Center=pt, Factor=number_slider)  # -> Geometry, Transform
bang_2 = ExplodeTree(Data=scale.Geometry)  # -> Branch0, Branch1, Branch2
vec = VectorXYZ(XComponent=number_slider_2, YComponent=0, ZComponent=0)  # -> Vector, Length
item = ListItem(List=cull_i, Index="1", Wrap=True)
vec_2 = VectorXYZ(XComponent=number_slider_2, YComponent=0, ZComponent=Slider(19.46, range=0..100))  # -> Vector, Length
division = Division(A=item, B="2")
move = Move(Geometry=bang_2.Branch1, Motion=vec.Vector)  # -> Geometry, Transform
move_2 = Move(Geometry=bang.Branch1, Motion=vec_2.Vector)  # -> Geometry, Transform
addition = Addition(A=cull_i, B=division)
arc = Arc3Pt(PointA=bang_2.Branch0, PointB=move.Geometry, PointC=bang_2.Branch2)  # -> Arc, Plane, Radius
arc_2 = Arc3Pt(PointA=bang.Branch0, PointB=move_2.Geometry, PointC=bang.Branch2)  # -> Arc, Plane, Radius
mod = Modulus(A=addition, B=pi)
rotate = Rotate(Geometry=arc_2.Arc, Angle=cull_i, Plane=PlaneXY(0, 0, 0))  # -> Geometry, Transform
rotate_2 = Rotate(Geometry=arc.Arc, Angle=mod, Plane=PlaneXY(0, 0, 0))  # -> Geometry, Transform
weave = Weave(Pattern=[0, 1], Stream0=rotate.Geometry, Stream1=rotate_2.Geometry, NullGaps=False)
loft = Loft(Curves=weave, Options={Adjust=False, Closed=True, LoftEnds=0, LoftSimp=0, LoftType=3, Rebuild=10, Refit=0.01})
mesh = Mesh(loft)
area = Area(Geometry=loft)  # -> Area, Centroid
context_bake = ContextBake(Content=mesh)
context_print = ContextPrint(Text=area.Area)
